# Grasshopper definition portal-example.gh (Grasshopper 1.0.7)
# plug-ins: Portal.Gh

concat = Concatenate(FragmentA="hey there from pipe ", FragmentB=Slider(83, range=0..100))
concat_2 = Concatenate(FragmentA="hey there from meory ", FragmentB=Slider(2380, range=0..10000))
# Memory Mapped File
panel = Panel("TestMemoryBlock")
# WebSocket
number_slider = Slider(6001, range=0..10000)
# UDP
number_slider_2 = Slider(6000, range=0..10000)
toggle = BooleanToggle(False)
# Pipe
panel_2 = Panel("TestPipe")
enbytes = BytesEncoder(Text=concat_2)
enbytes_2 = BytesEncoder(Text=concat)
enbytes_3 = BytesEncoder(Text="hey there from ws ")
enbytes_4 = BytesEncoder(Text="hey there from client")
memory = SharedMemoryWriter(MemoryName=panel, Bytes=enbytes, Write=Toggle(False))
pipe = NamedPipeSender(ServerName=".", PipeName=panel_2, Bytes=enbytes_2, Send=Button())
udp = UDPSender(ServerIP="127.0.0.1", Port=number_slider_2, Bytes=enbytes_4, Send=Button())
ws_client = WebSocketClient(HostIP="127.0.0.1", Port=number_slider, Route="/test", Bytes=enbytes_3, Send=Button())
pipe_2 = NamedPipeReceiver(PipeName=panel_2, Start=Toggle(False))
ws_server = WebSocketServer(Port=number_slider, Route="/test", Start=Toggle(False))
udp_2 = UdpReceiver(Port=number_slider_2, Start=Toggle(True))
memory_2 = SharedMemoryAutoReader(MemoryName=panel, Interval=Slider(200, range=0..1000), Start=Toggle(False))
memory_3 = SharedMemoryReader(MemoryName=panel, Start=Button())
debytes = BytesDecoder(Bytes=pipe_2)
debytes_2 = BytesDecoder(Bytes=ws_server)
debytes_3 = BytesDecoder(Bytes=udp_2)
debytes_4 = BytesDecoder(Bytes=memory_2)
debytes_5 = BytesDecoder(Bytes=memory_3)
panel_3 = Panel(debytes)
panel_4 = Panel(debytes_2)
panel_5 = Panel(debytes_3)
panel_6 = Panel(debytes_4)
panel_7 = Panel(debytes_5)
crv = Curve(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)
mesh = Mesh(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)
pt = Point([Point(2.174324685, -5.670873841, 0), Point(6.052849799, -3.32025256, 0), Point(-0.3525931922, -0.9108657465, 0), Point(-4.936304691, -1.145927875, 0), Point(-7.463222568, -5.141984053, 0), Point(-1.057779577, -8.080260655, 0), Point(6.111615331, -8.315322783, 0), Point(0.9402485125, -5.494577245, 0), Point(-1.880497025, -2.438769579, 0), Point(2.585683409, 2.908893836, 0), Point(-5.347663415, 5.729639373, 0), Point(-9.872609382, 3.379018092, 0), Point(-13.16347918, -1.557286599, 0), Point(-16.10175578, -5.905935969, 0), Point(-11.75310641, -8.961743635, 0), Point(-5.700256607, -9.490633423, 0)])
srcrv = SerializeCurve(Curves=crv)
srmesh = SerializeMesh(Mesh=mesh)
srpt = SerializePoints(Points=pt)
enb = BytesEncoder(Text=srcrv)
enb_2 = BytesEncoder(Text=srmesh)
cb = CompressBytes(Bytes=enb)
panel_8 = Panel(srpt)
info = NetworkInfo()  # -> Properties, LocalIP
cb_2 = CompressBytes(Bytes=enb_2)
panel_9 = Panel(srcrv)
file = FileReader(FilePath="F:\projects\voxel-analyser\voxels_with_slope.json")
bytes = Bytes(cb)
bytes_2 = Bytes(cb_2)
panel_10 = Panel(info.Properties)
decb = DecompressBytes(Bytes=bytes_2)
decb_2 = DecompressBytes(Bytes=bytes)
cb_3 = CompressBytes(Bytes=file)
dsrcrv = DeserializeCurve(JsonData=srcrv)
dsrpt = DeserializePoints(JsonData=srpt)
deb = BytesDecoder(Bytes=decb)
deb_2 = BytesDecoder(Bytes=decb_2)
decb_3 = DecompressBytes(Bytes=cb_3)
panel_11 = Panel(dsrpt)
panel_12 = Panel(dsrcrv)
dsrmesh = DeserializeMesh(JsonData=deb)
panel_13 = Panel(deb_2)
deb_3 = BytesDecoder(Bytes=decb_3)
panel_14 = Panel(dsrmesh)
